# Grasshopper definition Tutorial-3-7-1-Sloped-roof.gh (Grasshopper 1.0.8)

# ---- group: Number of runs
number_slider = Slider(6, range=6..24)

# ----
# Create a parametric truss system that changes gradually in height as shown in the image.
image = ImageSampler(Filter="Colour", Interpolate=False, Umax=1, Umin=0, Vmax=1, Vmin=0, Wrap=1)

# ---- group: Number of trusses
# Step 2
# Plug the solution we had for a single truss
number_slider_2 = Slider(6, range=0..20)

# ---- group: Variable height
# Step 3
# I dentify bottom and top grid of points, then connect corresponding elements in different branchs
panel = Panel("1 to 3")
range = Range(Domain=panel, Steps=expr("x-1", number_slider_2))

# ---- group: Distance between trusses
# Step 1
# Create base lines
number_slider_3 = Slider(2.2, range=1..10)

# ---- group: Number of runs
# Number of runs 6-20
panel_2 = Panel("10")

# ---- group: Height
# Variable height 1-3
panel_3 = Panel("7")

# ---- group: Input line
# Use previous truss solution with necessary modifications
# Use multiple lines
line = Line(Line((2, 18, 0), (40, 18, 0)))

# ----
Z = UnitZ(Factor=range)

# ---- group: Divide line to double number of runs
multiplication = Multiplication(A=panel_2, B="2")
divide = DivideCurve(Curve=line, Count=multiplication, Kinks=False)  # -> Points, Tangents, Parameters

# ---- group: Generate list of distances
series = Series(Start=0, Step=number_slider_3, Count=number_slider_2)

# ----
panel_4 = Panel("""False
True""")
panel_5 = Panel(series)
panel_6 = Panel("""False
True""")
Y = UnitY(Factor=series)

# ---- group: Initial input line along x-axis
line_2 = Line(Line((2, 2, 0), (18, 2, 0)))

# ---- group: Copy line
move = Move(Geometry=line_2, Motion=Y)  # -> Geometry, Transform

# ---- group: List of lines
crv = Curve(move.Geometry)

# ---- group: Divide line to double number of runs
multiplication_2 = Multiplication(A=number_slider, B="2")
divide_2 = DivideCurve(Curve=crv, Count=multiplication_2, Kinks=False)  # -> Points, Tangents, Parameters

# ---- group: Bottom points
cull = CullPattern(List=divide_2.Points, CullPattern=invert(panel_4))

# ---- group: Base Points
pt = Point(cull)

# ----
viewer = ParamViewer(pt)
flip = FlipMatrix(Data=pt)

# ---- group: Top points
cull_2 = CullPattern(List=divide_2.Points, CullPattern=panel_4)
move_2 = Move(Geometry=cull_2, Motion=Z)  # -> Geometry, Transform

pt_2 = Point(move_2.Geometry)

# ----
viewer_2 = ParamViewer(pt_2)
flip_2 = FlipMatrix(Data=pt_2)

# ---- group: Top points
cull_3 = CullPattern(List=divide.Points, CullPattern=panel_6)
Z_2 = UnitZ(Factor=panel_3)
move_3 = Move(Geometry=cull_3, Motion=Vector(0, 0, 7))  # -> Geometry, Transform

# ---- group: Bottom points
cull_4 = CullPattern(List=divide.Points, CullPattern=invert(panel_6))

# ----
viewer_3 = ParamViewer(flip_2)
viewer_4 = ParamViewer(flip)

# ---- group: Base Points
pt_3 = Point(cull)

# ---- group: Weave into one list
weave = Weave(Pattern=[0, 1], Stream0=cull, Stream1=move_2.Geometry, NullGaps=False)

# ---- group: Top points
pt_4 = Point(move_2.Geometry)

# ---- group: Middle points
weave_2 = Weave(Pattern=[0, 1], Stream0=cull_4, Stream1=move_3.Geometry, NullGaps=False)

# ---- group: Top
pline = PolyLine(Vertices=move_2.Geometry, Closed=False)

# ---- group: Middle
pline_2 = PolyLine(Vertices=weave, Closed=False)

# ---- group: Bottom
pline_3 = PolyLine(Vertices=cull, Closed=False)

# ---- group: Cross Bottom
pline_4 = PolyLine(Vertices=flip, Closed=False)

# ---- group: Cross Top
pline_5 = PolyLine(Vertices=flip_2, Closed=False)

# ---- group: Top
# Create pipes through curves
pline_6 = PolyLine(Vertices=move_3.Geometry, Closed=False)

# ---- group: Middle
pline_7 = PolyLine(Vertices=weave_2, Closed=False)

# ---- group: Bottom
pline_8 = PolyLine(Vertices=cull_4, Closed=False)

# ---- group: Pipe truss
pipe = Pipe(Curve=pline_2, Radius="0.02", Caps=0)

# ---- group: Pipe top and base
pipe_2 = Pipe(Curve=[pline, pline_3], Radius="0.01", Caps=0)

# ---- group: Pipe cross beams
pipe_3 = Pipe(Curve=[pline_4, pline_5], Radius="0.05", Caps=0)

# ----
preview = CustomPreview(Geometry=pipe_3, Material=ColourSwatch(SwatchColor=RGB(168, 222, 255)))
preview_2 = CustomPreview(Geometry=[pipe, pipe_2], Material=ColourSwatch(SwatchColor=RGB(161, 96, 96)))
