# Grasshopper definition Tutorial-3-7-2-Diagonal triangles.gh (Grasshopper 1.0.8)

# Given the input grid, use the RelativeItem component to create diagonal triangles
image = ImageSampler(Filter="Colour", Interpolate=False, Umax=1, Umin=0, Vmax=1, Vmin=0, Wrap=1)

# ---- group: Branch spans
panel = Panel("6")

# ---- group: Element spans
panel_2 = Panel("8")

# ----
sqgrid = Square(Plane=PlaneXY(0, 0, 0), Size=1, ExtentX=panel, ExtentY=panel_2)  # -> Cells, simplify(Points)
preview = CustomPreview(Geometry=sqgrid.Points, Material=ColourSwatch(SwatchColor=RGB(161, 96, 96)))

# ---- group: Offset mask
panel_3 = Panel("{+1}[+1]")

# ----
viewer = ParamViewer(sqgrid.Points)

# ---- group: Split in 2 trees using offset mask
relitem = RelativeItem(Tree=sqgrid.Points, Offset=panel_3, WrapPaths=False, WrapItems=False)  # -> ItemA, ItemB

# ---- group: Create 3rd set of points
Z = UnitZ(Factor=1)
move = Move(Geometry=relitem.ItemB, Motion=Z)  # -> Geometry, Transform

# ----
viewer_2 = ParamViewer(relitem.ItemA)
viewer_3 = ParamViewer(relitem.ItemB)

# ---- group: B branch
flatten = FlattenTree(Tree=relitem.ItemB, Path="{1}")

# ---- group: A branch
flatten_2 = FlattenTree(Tree=relitem.ItemA, Path="{0}")

# ---- group: C branch
flatten_3 = FlattenTree(Tree=move.Geometry, Path="{2}")

# ----
viewer_4 = ParamViewer(move.Geometry)

# ---- group: Create one strucuture for the 3 sets
merge = Merge(Data1=flatten_2, Data2=flatten, Data3=flatten_3)

# ----
viewer_5 = ParamViewer(merge)

# ---- group: Group corresponding corners
flip = FlipMatrix(Data=merge)

# ----
viewer_6 = ParamViewer(flip)

# ---- group: Create boundary curve
pline = PolyLine(Vertices=flip, Closed=True)

# ---- group: Create surfaces
boundary = BoundarySurfaces(Edges=flatten(pline))

# ----
preview_2 = CustomPreview(Geometry=boundary, Material=ColourSwatch(SwatchColor=RGB(168, 222, 255)))
