# Grasshopper definition Tutorial-3-7-3-Zigzag.gh (Grasshopper 1.0.8)

# Create the structure shown in the image using a base grid as input.
image = ImageSampler(Filter="Colour", Interpolate=False, Umax=1, Umin=0, Vmax=1, Vmin=0, Wrap=1)

# ---- group: Bottom grid / Branch spans
panel = Panel("6")

# ---- group: Bottom grid / Element spans
panel_2 = Panel("8")

# ---- group: Bottom grid
sqgrid = Square(Plane=PlaneXY(0, 0, 0), Size=1, ExtentX=panel, ExtentY=panel_2)  # -> Cells, simplify(Points)

# ---- group: Top grid
Z = UnitZ(Factor=1)
move = Move(Geometry=sqgrid.Points, Motion=Z)  # -> Geometry, Transform

# ----
points = PointList(Points=move.Geometry, Size=0.1)

# ---- group: Split bottom grid
split = SplitTree(Data=sqgrid.Points, Masks=flatten("{0,2,...}"))  # -> Positive, Negative

# ---- group: Split top grid
split_2 = SplitTree(Data=move.Geometry, Masks=flatten("{0,2,...}"))  # -> Positive, Negative

# ---- group: Find relative trees of the positive part
relitem2 = RelativeItems(TreeA=split.Positive, TreeB=split_2.Positive, Offset="{0}[+1]", WrapPaths=False, WrapItems=False)  # -> ItemA, ItemB

# ---- group: Shift positive bottom
shift = ShiftList(List=split.Positive, Shift=1, Wrap=False)

# ---- group: Reverse negative and find trees, shift and weave
relitem2_2 = RelativeItems(TreeA=reverse(split.Negative), TreeB=reverse(split_2.Negative), Offset="{0}[+1]", WrapPaths=False, WrapItems=False)  # -> ItemA, ItemB
shift_2 = ShiftList(List=reverse(split.Negative), Shift=1, Wrap=False)
weave = Weave(Pattern=[0, 1, 2], Stream0=relitem2_2.ItemA, Stream1=relitem2_2.ItemB, Stream2=shift_2, NullGaps=False)
dcon = DeleteConsecutive(Set=weave, Wrap=False)  # -> Set, Count

# ---- group: Weave points and remove duplicates
weave_2 = Weave(Pattern=[0, 1, 2], Stream0=relitem2.ItemA, Stream1=relitem2.ItemB, Stream2=shift, NullGaps=False)
dcon_2 = DeleteConsecutive(Set=weave_2, Wrap=False)  # -> Set, Count

# ---- group: Merge into one strucuture
merge = Merge(Data1=dcon_2.Set, Data2=dcon.Set)

# ---- group: Create pipes
pline = PolyLine(Vertices=merge, Closed=False)
pipe = Pipe(Curve=pline, Radius=Slider(0.022, range=0.01..0.1), Caps=0)

# ---- group: Display
preview = CustomPreview(Geometry=pipe, Material=ColourSwatch(SwatchColor=RGB(45, 164, 237)))
