# Grasshopper definition Tutorial-3-7-4-Truss.gh (Grasshopper 1.0.8)

# Use relative items between the 2 given bounding grids to generate a truss system similar to the image
image = ImageSampler(
    FilePath="C:\dev\github\mcneel\developer.rhino3d.com\content\en\guides\grasshopper\gh-algorithms-and-data-structures\advanced-data-structures\ads-351.png",
    Filter="Colour",
    Interpolate=False,
    Umax=1,
    Umin=0,
    Vmax=1,
    Vmin=0,
    Wrap=1)

# ---- group: Top grid
pt = Point(Tree({0}: [Point(0, 0, 1.291502622), Point(0, 1, 1.916079783), Point(0, 2, 2.32455532), Point(0, 3, 2.557438524), Point(0, 4, 2.633249581), Point(0, 5, 2.557438524), Point(0, 6, 2.32455532), Point(0, 7, 1.916079783), Point(0, 8, 1.291502622)], {1}: [Point(1, 0, 1.744562647), Point(1, 1, 2.32455532), Point(1, 2, 2.708203932), Point(1, 3, 2.92820323), Point(1, 4, 3), Point(1, 5, 2.92820323), Point(1, 6, 2.708203932), Point(1, 7, 2.32455532), Point(1, 8, 1.744562647)], {2}: [Point(2, 0, 2), Point(2, 1, 2.557438524), Point(2, 2, 2.92820323), Point(2, 3, 3.141428429), Point(2, 4, 3.211102551), Point(2, 5, 3.141428429), Point(2, 6, 2.92820323), Point(2, 7, 2.557438524), Point(2, 8, 2)], {3}: [Point(3, 0, 2.08276253), Point(3, 1, 2.633249581), Point(3, 2, 3), Point(3, 3, 3.211102551), Point(3, 4, 3.280109889), Point(3, 5, 3.211102551), Point(3, 6, 3), Point(3, 7, 2.633249581), Point(3, 8, 2.08276253)], {4}: [Point(4, 0, 2), Point(4, 1, 2.557438524), Point(4, 2, 2.92820323), Point(4, 3, 3.141428429), Point(4, 4, 3.211102551), Point(4, 5, 3.141428429), Point(4, 6, 2.92820323), Point(4, 7, 2.557438524), Point(4, 8, 2)], {5}: [Point(5, 0, 1.744562647), Point(5, 1, 2.32455532), Point(5, 2, 2.708203932), Point(5, 3, 2.92820323), Point(5, 4, 3), Point(5, 5, 2.92820323), Point(5, 6, 2.708203932), Point(5, 7, 2.32455532), Point(5, 8, 1.744562647)], {6}: [Point(6, 0, 1.291502622), Point(6, 1, 1.916079783), Point(6, 2, 2.32455532), Point(6, 3, 2.557438524), Point(6, 4, 2.633249581), Point(6, 5, 2.557438524), Point(6, 6, 2.32455532), Point(6, 7, 1.916079783), Point(6, 8, 1.291502622)]))

# ---- group: Bottom grid
pt_2 = Point(Tree({0}: [Point(0, 0, 1), Point(0, 1, 1), Point(0, 2, 1), Point(0, 3, 1), Point(0, 4, 1), Point(0, 5, 1), Point(0, 6, 1), Point(0, 7, 1), Point(0, 8, 1)], {1}: [Point(1, 0, 1), Point(1, 1, 1), Point(1, 2, 1), Point(1, 3, 1), Point(1, 4, 1), Point(1, 5, 1), Point(1, 6, 1), Point(1, 7, 1), Point(1, 8, 1)], {2}: [Point(2, 0, 1), Point(2, 1, 1), Point(2, 2, 1), Point(2, 3, 1), Point(2, 4, 1), Point(2, 5, 1), Point(2, 6, 1), Point(2, 7, 1), Point(2, 8, 1)], {3}: [Point(3, 0, 1), Point(3, 1, 1), Point(3, 2, 1), Point(3, 3, 1), Point(3, 4, 1), Point(3, 5, 1), Point(3, 6, 1), Point(3, 7, 1), Point(3, 8, 1)], {4}: [Point(4, 0, 1), Point(4, 1, 1), Point(4, 2, 1), Point(4, 3, 1), Point(4, 4, 1), Point(4, 5, 1), Point(4, 6, 1), Point(4, 7, 1), Point(4, 8, 1)], {5}: [Point(5, 0, 1), Point(5, 1, 1), Point(5, 2, 1), Point(5, 3, 1), Point(5, 4, 1), Point(5, 5, 1), Point(5, 6, 1), Point(5, 7, 1), Point(5, 8, 1)], {6}: [Point(6, 0, 1), Point(6, 1, 1), Point(6, 2, 1), Point(6, 3, 1), Point(6, 4, 1), Point(6, 5, 1), Point(6, 6, 1), Point(6, 7, 1), Point(6, 8, 1)]))

# ---- group: Top grid
# Create top and bottom beams
pt_3 = Point(Tree({0}: [Point(0, 0, 1.291502622), Point(0, 1, 1.916079783), Point(0, 2, 2.32455532), Point(0, 3, 2.557438524), Point(0, 4, 2.633249581), Point(0, 5, 2.557438524), Point(0, 6, 2.32455532), Point(0, 7, 1.916079783), Point(0, 8, 1.291502622)], {1}: [Point(1, 0, 1.744562647), Point(1, 1, 2.32455532), Point(1, 2, 2.708203932), Point(1, 3, 2.92820323), Point(1, 4, 3), Point(1, 5, 2.92820323), Point(1, 6, 2.708203932), Point(1, 7, 2.32455532), Point(1, 8, 1.744562647)], {2}: [Point(2, 0, 2), Point(2, 1, 2.557438524), Point(2, 2, 2.92820323), Point(2, 3, 3.141428429), Point(2, 4, 3.211102551), Point(2, 5, 3.141428429), Point(2, 6, 2.92820323), Point(2, 7, 2.557438524), Point(2, 8, 2)], {3}: [Point(3, 0, 2.08276253), Point(3, 1, 2.633249581), Point(3, 2, 3), Point(3, 3, 3.211102551), Point(3, 4, 3.280109889), Point(3, 5, 3.211102551), Point(3, 6, 3), Point(3, 7, 2.633249581), Point(3, 8, 2.08276253)], {4}: [Point(4, 0, 2), Point(4, 1, 2.557438524), Point(4, 2, 2.92820323), Point(4, 3, 3.141428429), Point(4, 4, 3.211102551), Point(4, 5, 3.141428429), Point(4, 6, 2.92820323), Point(4, 7, 2.557438524), Point(4, 8, 2)], {5}: [Point(5, 0, 1.744562647), Point(5, 1, 2.32455532), Point(5, 2, 2.708203932), Point(5, 3, 2.92820323), Point(5, 4, 3), Point(5, 5, 2.92820323), Point(5, 6, 2.708203932), Point(5, 7, 2.32455532), Point(5, 8, 1.744562647)], {6}: [Point(6, 0, 1.291502622), Point(6, 1, 1.916079783), Point(6, 2, 2.32455532), Point(6, 3, 2.557438524), Point(6, 4, 2.633249581), Point(6, 5, 2.557438524), Point(6, 6, 2.32455532), Point(6, 7, 1.916079783), Point(6, 8, 1.291502622)]))

# ---- group: Top bars
panel = Panel("""False
True""")
cull = CullPattern(List=pt_3, CullPattern=panel)
flip = FlipMatrix(Data=cull)
pline = PolyLine(Vertices=cull, Closed=False)
pline_2 = PolyLine(Vertices=flip, Closed=False)

# ---- group: Bottom grid
pt_4 = Point(Tree({0}: [Point(0, 0, 1), Point(0, 1, 1), Point(0, 2, 1), Point(0, 3, 1), Point(0, 4, 1), Point(0, 5, 1), Point(0, 6, 1), Point(0, 7, 1), Point(0, 8, 1)], {1}: [Point(1, 0, 1), Point(1, 1, 1), Point(1, 2, 1), Point(1, 3, 1), Point(1, 4, 1), Point(1, 5, 1), Point(1, 6, 1), Point(1, 7, 1), Point(1, 8, 1)], {2}: [Point(2, 0, 1), Point(2, 1, 1), Point(2, 2, 1), Point(2, 3, 1), Point(2, 4, 1), Point(2, 5, 1), Point(2, 6, 1), Point(2, 7, 1), Point(2, 8, 1)], {3}: [Point(3, 0, 1), Point(3, 1, 1), Point(3, 2, 1), Point(3, 3, 1), Point(3, 4, 1), Point(3, 5, 1), Point(3, 6, 1), Point(3, 7, 1), Point(3, 8, 1)], {4}: [Point(4, 0, 1), Point(4, 1, 1), Point(4, 2, 1), Point(4, 3, 1), Point(4, 4, 1), Point(4, 5, 1), Point(4, 6, 1), Point(4, 7, 1), Point(4, 8, 1)], {5}: [Point(5, 0, 1), Point(5, 1, 1), Point(5, 2, 1), Point(5, 3, 1), Point(5, 4, 1), Point(5, 5, 1), Point(5, 6, 1), Point(5, 7, 1), Point(5, 8, 1)], {6}: [Point(6, 0, 1), Point(6, 1, 1), Point(6, 2, 1), Point(6, 3, 1), Point(6, 4, 1), Point(6, 5, 1), Point(6, 6, 1), Point(6, 7, 1), Point(6, 8, 1)]))

# ---- group: Bottom cross bars
panel_2 = Panel("""True
False""")
cull_2 = CullPattern(List=pt_4, CullPattern=panel_2)
flip_2 = FlipMatrix(Data=cull_2)
pline_3 = PolyLine(Vertices=cull_2, Closed=False)
pline_4 = PolyLine(Vertices=flip_2, Closed=False)

# ---- group: Create middle bars
# Create middle beams
weave = Weave(Pattern=[0, 1], Stream0=cull_2, Stream1=cull, NullGaps=False)
pline_5 = PolyLine(Vertices=weave, Closed=False)
pipe = Pipe(Curve=pline_5, Radius=Slider(0.025, range=0.01..0.1), Caps=0)
preview = CustomPreview(Geometry=pipe, Material=ColourSwatch(SwatchColor=RGB(129, 139, 237)))

# ----
# Understand the input:
viewer = ParamViewer(pt)
viewer_2 = ParamViewer(pt_2)

# ---- group: Offset mask
# Create plates and their frames
panel_3 = Panel("{0}[+1]")

# ----
relitem = RelativeItem(Tree=cull_2, Offset=panel_3, WrapPaths=False, WrapItems=False)  # -> flatten(ItemA), flatten(ItemB)
pline_6 = PolyLine(Vertices=pt_2, Closed=False)
points = PointList(Points=pt_2, Size=0.2)
points_2 = PointList(Points=pt, Size=0.2)
pline_7 = PolyLine(Vertices=pt, Closed=False)
flatten = FlattenTree(Tree=cull, Path="{0}")

# ---- group: 2nd corner
pt_5 = Point(graft(relitem.ItemB))

# ---- group: 1st corner
pt_6 = Point(graft(relitem.ItemA))

# ---- group: 3nd corner
pt_7 = Point(graft(flatten))

# ----
weave_2 = Weave(Pattern=[0, 1, 2], Stream0=pt_6, Stream1=pt_5, Stream2=pt_7, NullGaps=False)
pipe_2 = Pipe(Curve=[pline, pline_2, pline_3, pline_4], Radius=Slider(0.034, range=0.01..0.1), Caps=0)
pline_8 = PolyLine(Vertices=weave_2, Closed=Toggle(True))
offset = OffsetCurve(Curve=pline_8, Distance="-0.075", Corners=1)

# ---- group: Create plate surfaces
boundary = BoundarySurfaces(Edges=flatten(offset))

# ---- group: Create plate frames
pipe_3 = Pipe(Curve=offset, Radius=Slider(0.022, range=0.01..0.1), Caps=0)

# ----
preview_2 = CustomPreview(Geometry=pipe_2, Material=ColourSwatch(SwatchColor=RGB(168, 222, 255)))
preview_3 = CustomPreview(Geometry=pipe_3, Material=ColourSwatch(SwatchColor=RGB(110, 94, 53)))
preview_4 = CustomPreview(Geometry=boundary, Material=ColourSwatch(SwatchColor=RGBA(255, 194, 28, 221)))
