# Grasshopper definition Tutorial-3-7-5-Weaving.gh (Grasshopper 1.0.8)

image = ImageSampler(Filter="Colour", Interpolate=False, Umax=1, Umin=0, Vmax=1, Vmin=0, Wrap=1)
# Create flat weave of threads using a rectangular grid as an initial input. Set your desired density and size.
# 
# Bonus:
# Weave along any surface
image_2 = ImageSampler(Filter="Colour", Interpolate=False, Umax=1, Umin=0, Vmax=1, Vmin=0, Wrap=1)
number_slider = Slider(0.086, range=0..1)
number_slider_2 = Slider(2.5, range=1..10)

# ---- group: Parameters
number_slider_3 = Slider(20, range=8..40)
number_slider_4 = Slider(8, range=8..28)
number_slider_5 = Slider(0.279, range=0..1)
number_slider_6 = Slider(0.169, range=0..1)

# ---- group: Multi-line input is combined
panel = Panel("""{*;(0,2,...)}[0,2,...]
{*;(1,3,...)}[1,3,...]""")

# ---- group: surface
S = Surface(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)

# ---- group: Selection mask
panel_2 = Panel("""{*;(0,2,...)}[0,2,...]
{*;(1,3,...)}[1,3,...]""")

# ---- group: planar grid
recgrid = Rectangular(
    Plane=PlaneXY(0, 0, 0),
    SizeX=number_slider_2,
    SizeY=number_slider_2,
    ExtentX=Slider(5, range=5..10),
    ExtentY=Slider(5, range=5..10))  # -> Cells, Points

# ---- group: divide srf
sdivide = DivideSurface(Surface=S, UCount=number_slider_3, VCount=number_slider_4)  # -> Points, Normals, Parameters

# ----
flip = FlipMatrix(Data=recgrid.Points)

# ---- group: Flipped points grid
flip_2 = FlipMatrix(Data=sdivide.Points)

# ---- group: Flipped normals grid
flip_3 = FlipMatrix(Data=sdivide.Normals)

# ---- group: Isolate points to move
split = SplitTree(Data=flip, Masks=panel)  # -> Positive, Negative
split_2 = SplitTree(Data=recgrid.Points, Masks=panel)  # -> Positive, Negative

split_3 = SplitTree(Data=sdivide.Points, Masks=panel_2)  # -> Positive, Negative
split_4 = SplitTree(Data=flip_2, Masks=panel_2)  # -> Positive, Negative

# ----
Z = UnitZ(Factor=Slider(0.204, range=0..1))
num = Number(number_slider_5)

# ---- group: Move isolated points up and down
move = Move(Geometry=split_2.Negative, Motion=expr("-x", Z))  # -> Geometry, Transform
move_2 = Move(Geometry=split.Positive, Motion=expr("-x", Z))  # -> Geometry, Transform
move_3 = Move(Geometry=split_2.Positive, Motion=Z)  # -> Geometry, Transform
move_4 = Move(Geometry=split.Negative, Motion=Z)  # -> Geometry, Transform

# ---- group: Move up and down
amp = Amplitude(Vector=sdivide.Normals, Amplitude=num)
amp_2 = Amplitude(Vector=sdivide.Normals, Amplitude=num)
amp_3 = Amplitude(Vector=flip_3, Amplitude=num)
amp_4 = Amplitude(Vector=flip_3, Amplitude=num)
move_5 = Move(Geometry=split_3.Positive, Motion=amp)  # -> Geometry, Transform
move_6 = Move(Geometry=split_4.Negative, Motion=amp_4)  # -> Geometry, Transform

# ---- group: Recombine points
combine = CombineData(Input0=move_4.Geometry, Input1=move_2.Geometry)  # -> Result, Index
combine_2 = CombineData(Input0=move_3.Geometry, Input1=move.Geometry)  # -> Result, Index

# ---- group: Move up and down / T = -T
move_7 = Move(Geometry=split_3.Negative, Motion=expr("-x", amp_2))  # -> Geometry, Transform

move_8 = Move(Geometry=split_4.Positive, Motion=expr("-x", amp_3))  # -> Geometry, Transform

# ---- group: Generate curves through points
intcrv = Interpolate(Vertices=combine.Result, Degree="3", Periodic=False, KnotStyle=1)  # -> Curve, Length, Domain
intcrv_2 = Interpolate(Vertices=combine_2.Result, Degree="3", Periodic=False, KnotStyle=1)  # -> Curve, Length, Domain

# ---- group: Recombine points
combine_3 = CombineData(Input0=move_5.Geometry, Input1=move_7.Geometry)  # -> Result, Index
combine_4 = CombineData(Input0=move_6.Geometry, Input1=move_8.Geometry)  # -> Result, Index

# ----
pipe = Pipe(Curve=intcrv_2.Curve, Radius=number_slider, Caps=0)
pipe_2 = Pipe(Curve=intcrv.Curve, Radius=number_slider, Caps=0)

# ---- group: Generate curves
intcrv_3 = Interpolate(Vertices=combine_3.Result, Degree="3", Periodic=False, KnotStyle=1)  # -> Curve, Length, Domain
intcrv_4 = Interpolate(Vertices=combine_4.Result, Degree="3", Periodic=False, KnotStyle=1)  # -> Curve, Length, Domain

# ----
num_2 = Number(number_slider_6)
preview = CustomPreview(Geometry=pipe, Material=ColourSwatch(SwatchColor=RGB(161, 96, 96)))
preview_2 = CustomPreview(Geometry=pipe_2, Material=ColourSwatch(SwatchColor=RGB(168, 222, 255)))
pipe_3 = Pipe(Curve=intcrv_3.Curve, Radius=num_2, Caps=0)
pipe_4 = Pipe(Curve=intcrv_4.Curve, Radius=num_2, Caps=0)
preview_3 = CustomPreview(Geometry=pipe_3, Shader=ColourSwatch(SwatchColor=RGB(161, 96, 96)))
preview_4 = CustomPreview(Geometry=pipe_4, Shader=ColourSwatch(SwatchColor=RGB(168, 222, 255)))
