# Grasshopper definition Tutorial-1-9-1-Unioned-circles.gh (Grasshopper 1.0.8)

# ---- group: Input plane
xy = XYPlane(Origin=Point(0, 0, 0))

xy_2 = XYPlane(Origin=Point(0, 0, 0))

xy_3 = XYPlane(Origin=Point(0, 0, 0))

# ---- group: X
# Create input to generate the second circle
# C2 moved along x by R1
panel = Panel("2")

# ---- group: Y
panel_2 = Panel("2")

# ---- group: Z
panel_3 = Panel("2")

# ---- group: Input plane
# Create input to generate the first circle
# Plane centered at (2,2,2)
xy_4 = XYPlane(Origin=Point(0, 0, 0))

# ---- group: X
# R2 = R1*1.2
panel_4 = Panel("2")

# ---- group: Y
panel_5 = Panel("2")

# ---- group: Z
panel_6 = Panel("2")

# ---- group: Input plane
xy_5 = XYPlane(Origin=Point(0, 0, 0))

# ---- group: X
# Random radius (range =3-6)
panel_7 = Panel("2")

# ---- group: Y
panel_8 = Panel("2")

# ---- group: Z
panel_9 = Panel("2")

# ---- group: Input plane
xy_6 = XYPlane(Origin=Point(0, 0, 0))

# Identify input needed for the key process (curves and plane - we have the plane)
# Identify input needed for the 2 circles
xy_7 = XYPlane(Origin=Point(0, 0, 0))

# ---- group: X
panel_10 = Panel("2")

# ---- group: Y
panel_11 = Panel("2")

# ---- group: Z
panel_12 = Panel("2")

# ---- group: Region union
# Identify key process (curve union operation)
runion = RegionUnion()

# ---- group: X
# Use the 4-step process to design an algorithm that combines 2 circles, given the following:
# Both circles are located on the XY-Plane. The first circle (Cir1) has a center (C1) = (2,2,2) and radius (R1) that is equal to a random number between 3 and 6. The second circle (Cir2) has a center (C2) that is shifted to the right of the first circle (Cir1) by an amount equal to the radius of the first circle (R1) along the positive X-Axis. The second circle radius (R2) is 20% bigger, or in other words (R2) = (R1) * 1.2.
# First analyze the problem and the general flow of the solution
# Input
panel_13 = Panel("2")

# ---- group: Y
# Circle 1
panel_14 = Panel("2")

# ---- group: Z
# Circle 2
panel_15 = Panel("2")

# ---- group: Union region
# Start with the output (union curve)
crv = Curve()

# ---- group: First circle plane / C1
pt = ConstructPoint(XCoordinate=panel_4, YCoordinate=panel_5, ZCoordinate=panel_6)

# ---- group: First circle plane
pln = Plane(xy)
pl_origin = PlaneOrigin(Base=pln, Origin=pt)

# ---- group: First circle radius
random = Random(Range="3 to 6", Number=1, Seed=2)

# ----
panel_16 = Panel(random)

# ---- group: First circle plane / C1
pt_2 = ConstructPoint(XCoordinate=panel, YCoordinate=panel_2, ZCoordinate=panel_3)

# ---- group: Region union
runion_2 = RegionUnion(Plane=xy_7)

# ---- group: First circle plane / C1
pt_3 = ConstructPoint(XCoordinate=panel_7, YCoordinate=panel_8, ZCoordinate=panel_9)

# ---- group: First circle plane
pln_2 = Plane(xy_2)
pl_origin_2 = PlaneOrigin(Base=pln_2, Origin=pt_2)

pln_3 = Plane(xy_3)
pl_origin_3 = PlaneOrigin(Base=pln_3, Origin=pt_3)

# ---- group: Union region
crv_2 = Curve(runion)

# ---- group: First circle plane / C1
pt_4 = ConstructPoint(XCoordinate=panel_10, YCoordinate=panel_11, ZCoordinate=panel_12)

# ---- group: First circle
cir1 = Circle(Plane=PlaneXY(0, 0, 0), Radius=1)

# ---- group: Second circle
cir2 = Circle(Plane=PlaneXY(0, 0, 0), Radius=1)

# ---- group: First circle plane
pln_4 = Plane(xy_5)
pl_origin_4 = PlaneOrigin(Base=pln_4, Origin=pt_4)

# ---- group: Radom number generator
random_2 = Random(Range="3 to 6", Number=1, Seed=2)

# ---- group: First circle radius
random_3 = Random(Range="3 to 6", Number=1, Seed=2)

# ----
panel_17 = Panel(random_3)
panel_18 = Panel(random_2)

# ---- group: Union region
crv_3 = Curve(runion_2)

# ---- group: Region union
runion_3 = RegionUnion(Curves=[cir1, cir2], Plane=xy_4)

# ---- group: move factor
X = UnitX(Factor=random)

# ---- group: First circle
cir1_2 = Circle(Plane=pl_origin, Radius=random)

# ---- group: First circle plane
pln_5 = Plane(pl_origin)

# ---- group: move factor
X_2 = UnitX(Factor=random_3)

# ---- group: First circle
cir1_3 = Circle(Plane=pl_origin_2, Radius=random_3)

cir1_4 = Circle(Plane=pl_origin_3, Radius=random_2)

# ---- group: First circle plane
pln_6 = Plane(pl_origin_2)

# ---- group: First circle
cir1_5 = Circle(Plane=pl_origin_4, Radius=1)

# ---- group: Second circle
cir2_2 = Circle(Plane=PlaneXY(0, 0, 0), Radius=1)

cir2_3 = Circle(Plane=PlaneXY(0, 0, 0), Radius=1)

# ---- group: Second circle radius
multiplication = Multiplication(A=random, B="1.2")

# ---- group: Second circle plane
move = Move(Geometry=pln_5, Motion=X)  # -> Geometry, Transform

# ---- group: Union region
crv_4 = Curve(runion_3)

# ---- group: Second circle plane
move_2 = Move(Geometry=pln_6, Motion=X_2)  # -> Geometry, Transform

# ---- group: Second circle
cir2_4 = Circle(Plane=move.Geometry, Radius=multiplication)

# ---- group: Region union
runion_4 = RegionUnion(Curves=[cir1_4, cir2_2], Plane=xy_3)

runion_5 = RegionUnion(Curves=[cir1_5, cir2_3], Plane=xy_5)

# ---- group: Second circle
cir2_5 = Circle(Plane=move_2.Geometry, Radius=1)

# ----
# Union
image = ImageSampler(Filter="Colour", Interpolate=False, Umax=1, Umin=0, Vmax=1, Vmin=0, Wrap=1)

# ---- group: Union region
crv_5 = Curve(runion_5)

crv_6 = Curve(runion_4)

# ---- group: Region union
runion_6 = RegionUnion(Curves=[cir1_2, cir2_4], Plane=xy)

runion_7 = RegionUnion(Curves=[cir1_3, cir2_5], Plane=xy_2)

# ---- group: Union region
crv_7 = Curve(runion_6)

crv_8 = Curve(runion_7)
