# Grasshopper definition Tutorial-1-9-2-Sphere-with-bounds.gh (Grasshopper 1.0.8)

# ---- group: Input radius within range
number_slider = Slider(-0.7, range=-5..10)

# 4- Intermediate input
# and processes
number_slider_2 = Slider(3.9, range=-5..10)

# 3- Input
number_slider_3 = Slider(3.9, range=-5..10)

# ---- group: Output sphere
# Use the 4-step process to draw a sphere with a radius between 2 and 6. If input is less than 2, then set the radius to 2, and if input radius is greater than 6, set the radius to 6. Use a number slider to input the radius and set between 0 and 10 to test. Make sure your solution is well organized, color-coded and labeled properly.
# 1- Output
geo = Geometry()

# ---- group: Create sphere from base plane and radius
# 2- Key Process
sph = Sphere(Base=PlaneXY(0, 0, 0), Radius=1)

# ---- group: Bounds
panel = Panel("2")
panel_2 = Panel("6")

panel_3 = Panel("2")
panel_4 = Panel("6")

panel_5 = Panel("2")
panel_6 = Panel("6")

# ---- group: Output sphere
geo_2 = Geometry(sph)

# ---- group: Construct logic list / Smaller than lower limit
smaller = SmallerThan(FirstNumber=number_slider, SecondNumber=panel)  # -> SmallerThan, OrEqualTo

# ---- group: Construct logic list / Larger than upper limit
larger = LargerThan(FirstNumber=number_slider, SecondNumber=panel_2)  # -> LargerThan, OrEqualTo

# ---- group: Create sphere from base plane and radius
sph_2 = Sphere(Base=PlaneXY(0, 0, 0), Radius=1)

# ---- group: Construct logic list / Within range (neither larger, nor smaller
xnor = GateXnor(A=smaller.SmallerThan, B=larger.LargerThan)

# ---- group: Construct list of radia
panel_7 = Panel([number_slider_2, panel_3, panel_4])

# ---- group: Logic list
panel_8 = Panel("")

# ---- group: Output sphere
geo_3 = Geometry(sph_2)

# ---- group: Construct list of radia
panel_9 = Panel([number_slider, panel, panel_2])

# ---- group: Logic list
panel_10 = Panel([xnor, smaller.SmallerThan, larger.LargerThan])

# ---- group: Filter options
dispatch = Dispatch(List=panel_7, DispatchPattern=panel_8)  # -> ListA, ListB

dispatch_2 = Dispatch(List=panel_9, DispatchPattern=panel_10)  # -> ListA, ListB

# ---- group: Create sphere from base plane and radius
sph_3 = Sphere(Base=PlaneXY(0, 0, 0), Radius=dispatch.ListA)

sph_4 = Sphere(Base=PlaneXY(0, 0, 0), Radius=dispatch_2.ListA)

# ---- group: Output sphere
geo_4 = Geometry(sph_3)

geo_5 = Geometry(sph_4)
