# Grasshopper definition Tutorial-1-9-3-Data-operations.gh (Grasshopper 1.0.8)

# ---- group: input numbers
num = Number([3, 24, 13, 55, 66, 21, 12, 6, 9, 14, 98, 8, 66, 43, 61, 62])

# Given the numbers embedded in the Number parameter do the following:
# 1. Analyze input in terms of bounds and distribution
# 2. View the data and how it is structured
# 3. Extract even numbers
# 4. Sort numbers descending
# 5. Remap sorted numbers to (100 to 200)
num_2 = Number([3, 24, 13, 55, 66, 21, 12, 6, 9, 14, 98, 8, 66, 43, 61, 62])

num_3 = Number([3, 24, 13, 55, 66, 21, 12, 6, 9, 14, 98, 8, 66, 43, 61, 62])

num_4 = Number([3, 24, 13, 55, 66, 21, 12, 6, 9, 14, 98, 8, 66, 43, 61, 62])

num_5 = Number([3, 24, 13, 55, 66, 21, 12, 6, 9, 14, 98, 8, 66, 43, 61, 62])

# ---- group: Input numbers
panel = Panel(num)

panel_2 = Panel(num_5)

# ---- group: Target domain
panel_3 = Panel("100 To 200")

# ---- group: Test if even
mod = Modulus(A=num_5, B="2")
equals = Equality(FirstNumber=mod, SecondNumber="0")  # -> Equality, Inequality

# ---- group: Sort function
sort = SortList(Keys=num)  # -> Keys, ValuesA

# ----
# Random distribution between 3 and 98
graph = QuickGraph(num_3, SortOrder=0)

# ---- group: Data structure: List of 16 numbers
viewer = ParamViewer(num_4)

# ----
panel_4 = Panel(num_4)

# ---- group: Output numbers
panel_5 = Panel(sort.Keys)

# ---- group: Output from even test
panel_6 = Panel(equals.Equality)

# ---- group: Reverse list
rev = ReverseList(List=sort.Keys)

# ---- group: Input sorted numbers
num_6 = Number(rev)

# ---- group: Input domain
bnd = Bounds(Numbers=num_6)

# ---- group: Check bounds result
panel_7 = Panel(bnd)

# ---- group: Remap numbers
remap = RemapNumbers(Value=num_6, Source=bnd, Target=panel_3)  # -> Mapped, Clipped

# ---- group: Output remapped numbers
panel_8 = Panel(remap.Mapped)

# ---- group: Filter even numbers
dispatch = Dispatch(List=num_5, DispatchPattern=equals.Equality)  # -> ListA, ListB

# ---- group: Output numbers
panel_9 = Panel(rev)

# ---- group: Even numbers
panel_10 = Panel(dispatch.ListA)
