# Grasshopper definition Tutorial-1-9-4-Algorithmic-pitfalls.gh (Grasshopper 1.0.8)

panel = Panel("""0
0.2
0.5
0.7
0.8
1""")

# ---- group: Set one curve
# Analyze what the following algorithm is intended to do, identify the errors that are preventing it from working as intended, then rewrite to fix the errors. Organize to reflect the algorithm flow, label and color-code.
crv = Curve(<curve referenced from the Rhino model>)

# ---- group: The components are not ordered from left to right with the flow of the script / Reparameterize the curve if evaluate domain as 0-1
crv_2 = Curve(<curve referenced from the Rhino model>)

# ---- group: Input curve reparameterize to 0-1
crv_3 = Curve(reparameterize(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))

# ---- group: The components are not ordered from left to right with the flow of the script / input a list in a panel need to use "multiline data"
panel_2 = Panel("""0
0.2
0.5
0.7
0.8
1""")

# ---- group: input list of normalized parameters
panel_3 = Panel("""0
0.2
0.5
0.7
0.8
1""")

# ----
eval = EvaluateCurve(Curve=crv, Parameter=panel)  # -> Point, Tangent, Angle

# ---- group: Locations on curve
eval_2 = EvaluateCurve(Curve=crv_3, Parameter=panel_3)  # -> Point, Tangent, Angle

# ---- group: Input radiuses with matching length
panel_4 = Panel("""1
1.1
0.9
0.9
0.5
0.2""")

# ---- group: The components are not ordered from left to right with the flow of the script / Invalid input
eval_3 = EvaluateCurve(Curve=crv_2, Parameter=panel_2)  # -> Point, Tangent, Angle

# ---- group: The components are not ordered from left to right with the flow of the script / Match input (list length > parameter list)
panel_5 = Panel("""1
1.1
0.9
0.9
0.5
0.2
0""")

# ----
panel_6 = Panel("""1
1.1
0.9
0.9
0.5
0.2
0""")

# ---- group: Circles normal to curve
circle = CircleCNR(Center=eval_2.Point, Normal=eval_2.Tangent, Radius=panel_4)

# ---- group: The components are not ordered from left to right with the flow of the script / Wrong component
cir = Circle(Plane=eval_3.Point, Radius=panel_5)

# ----
cir_2 = Circle(Plane=eval.Point, Radius=panel_6)

# ---- group: Loft surface
loft = Loft(Curves=circle, Options={Adjust=False, Closed=False, LoftEnds=0, LoftSimp=0, LoftType=0, Rebuild=10, Refit=0.01})

# ---- group: The components are not ordered from left to right with the flow of the script / Null input
loft_2 = Loft(Curves=cir, Options={Adjust=False, Closed=False, LoftEnds=0, LoftSimp=0, LoftType=0, Rebuild=10, Refit=0.01})

# ---- group: Output pipe
srf = Surface(loft)

# ----
loft_3 = Loft(Curves=cir_2, Options={Adjust=False, Closed=False, LoftEnds=0, LoftSimp=0, LoftType=0, Rebuild=10, Refit=0.01})
