# Grasshopper definition Tutorial-2-5-1-Variable-thickness-pipe.gh (Grasshopper 1.0.8)

# ---- group: Number of intervals
panel = Panel("10")

# ---- group: Input line
# Create a surface similar to the one in the image with thickness that changes in 10 locations random along the curve. Thickness variations are random between 1 and 3.
line = Line(Line((2, 3, 0), (8.2, 11.2, 10.2)))

# ---- group: Thickness range
# Solution
panel_2 = Panel("1 to 3")

# ---- group: Input line
line_2 = Line(Line((2, 3, 0), (8.2, 11.2, 10.2)))

# ---- group: Number of intervals
panel_3 = Panel("10")

# ---- group: Thickness range
panel_4 = Panel("1 to 3")

# ---- group: Random intervals
random = Random(Range=Domain(0, 1), Number=panel_3, Seed=2)
sort = SortList(Keys=random)  # -> flatten(Keys), ValuesA

# ---- group: Random thicknesses
random_2 = Random(Range=panel_4, Number=panel_3, Seed=2)

# ----
image = ImageSampler(Filter="Colour", Interpolate=False, Umax=1, Umin=0, Vmax=1, Vmin=0, Wrap=1)

# ---- group: Center points
eval = EvaluateCurve(Curve=line_2, Parameter=sort.Keys)  # -> Point, Tangent, Angle

# ---- group: Pipe curves
circle = CircleCNR(Center=eval.Point, Normal=eval.Tangent, Radius=random_2)

# ---- group: Pipe surface
loft = Loft(Curves=circle, Options={Adjust=False, Closed=False, LoftEnds=0, LoftSimp=0, LoftType=0, Rebuild=10, Refit=0.01})

# ---- group: Output
srf = Surface(loft)

# ----
merge = Merge(Data1="0", Data2=sort.Keys, Data3="1")
panel_5 = Panel(merge)
