# Grasshopper definition Tutorial-2-5-2-Custom-list-matching.gh (Grasshopper 1.0.8)

# ---- group: Lists of numbers
# Given the following three lists of numbers: [1, 2], [10, 20, 30] and [0.2, 0.4, 0.6, 0.9, 1], explain the default GH list matching when they are used as input. Compare the default matching with the Grasshopper Shortest List matching. Finally, use the original lists to create custom matching that repeats the pattern in the shorter lists to create a periodic matching until it matches the length of the longest list. For example [1,2] becomes [1,2,1,2,1].
num = Number([1, 2])
num_2 = Number([10, 20, 30])
# Solution
num_3 = Number([0.2, 0.4, 0.6, 0.8, 1])

# ---- group: Different list sizes
num_4 = Number([1, 2])
num_5 = Number([10, 20, 30])
num_6 = Number([0.2, 0.4, 0.6, 0.8, 1])

num_7 = Number([1, 2])
num_8 = Number([10, 20, 30])
num_9 = Number([0.2, 0.4, 0.6, 0.8, 1])

num_10 = Number([1, 2])
num_11 = Number([10, 20, 30])
num_12 = Number([0.2, 0.4, 0.6, 0.8, 1])

# ---- group: Find length of longest list
lng = ListLength(List=num_10)
lng_2 = ListLength(List=num_11)
lng_3 = ListLength(List=num_12)
bnd = Bounds(Numbers=[lng, lng_2, lng_3])
dedomain = DeconstructDomain(Domain=bnd)  # -> Start, End

# ----
panel = Panel(num)
panel_2 = Panel(num_2)
panel_3 = Panel(num_4)
panel_4 = Panel(num_8)
panel_5 = Panel(num_9)
panel_6 = Panel(num_3)
panel_7 = Panel(num_5)
panel_8 = Panel(num_6)
panel_9 = Panel(num_7)
pt = ConstructPoint(XCoordinate=num, YCoordinate=num_2, ZCoordinate=num_3)
pt_2 = ConstructPoint(XCoordinate=num_4, YCoordinate=num_5, ZCoordinate=num_6)
short = ShortestList(ListA=num_7, ListB=num_8, ListC=num_9, TrimMode=2)  # -> ListA, ListB, ListC
panel_10 = Panel(pt_2)
viewer = ParamViewer(pt_2)
panel_11 = Panel(dedomain.End)
panel_12 = Panel(short.ListA)
panel_13 = Panel(short.ListB)
panel_14 = Panel(short.ListC)
panel_15 = Panel(pt)
viewer_2 = ParamViewer(pt)

# ---- group: Repeat pattern to match longest
repeat = RepeatData(Data=num_10, Length=dedomain.End)
repeat_2 = RepeatData(Data=num_11, Length=dedomain.End)
repeat_3 = RepeatData(Data=num_12, Length=dedomain.End)

# ----
pt_3 = ConstructPoint(XCoordinate=short.ListA, YCoordinate=short.ListB, ZCoordinate=short.ListC)
panel_16 = Panel(pt_3)
viewer_3 = ParamViewer(pt_3)
panel_17 = Panel(repeat)
panel_18 = Panel(repeat_2)
panel_19 = Panel(repeat_3)

# ---- group: Last element in short lists is repeated to match longest list
panel_20 = Panel("""1
2
2
2
2""")
panel_21 = Panel("""10
20
30
30
30""")
panel_22 = Panel("""0.2
0.4
0.6
0.8
1.0""")

# ---- group: Create points
pt_4 = ConstructPoint(XCoordinate=repeat, YCoordinate=repeat_2, ZCoordinate=repeat_3)

# ----
pt_5 = ConstructPoint(XCoordinate=panel_20, YCoordinate=panel_21, ZCoordinate=panel_22)
viewer_4 = ParamViewer(pt_4)
panel_23 = Panel(pt_4)
panel_24 = Panel(pt_5)
viewer_5 = ParamViewer(pt_5)
