# Grasshopper definition Tutorial-2-5-3-Simple-truss.gh (Grasshopper 1.0.8)

# ---- group: Input line
# Q3
# Create simple truss as in the image. Use given baseline and other input
line = Line(Line((14.3, 2.1, 0), (78.2, 2.1, 0)))

# ---- group: Number of runs
panel = Panel("10")

# ---- group: Height
panel_2 = Panel("7")

# ---- group: Joint radius
# Solution
panel_3 = Panel("0.5")

# ---- group: Input line
line_2 = Line(Line((14.3, 2.1, 0), (78.2, 2.1, 0)))

# ---- group: Number of runs
panel_4 = Panel("10")

# ---- group: Height
panel_5 = Panel("7")

# ---- group: Joint radius
panel_6 = Panel("0.5")

# ----
image = ImageSampler(Filter="Colour", Interpolate=False, Umax=1, Umin=0, Vmax=1, Vmin=0, Wrap=1)

# ---- group: Divide line to double number of runs
multiplication = Multiplication(A=panel_4, B="2")
divide = DivideCurve(Curve=line_2, Count=multiplication, Kinks=False)  # -> Points, Tangents, Parameters

# ---- group: Top points
panel_7 = Panel("""False
True""")
Z = UnitZ(Factor=panel_5)
cull = CullPattern(List=divide.Points, CullPattern=panel_7)
move = Move(Geometry=cull, Motion=Z)  # -> Geometry, Transform

# ---- group: Bottom points
panel_8 = Panel("""False
True""")
cull_2 = CullPattern(List=divide.Points, CullPattern=invert(panel_8))

# ---- group: Weave into one list
weave = Weave(Pattern=[0, 1], Stream0=move.Geometry, Stream1=cull_2, NullGaps=False)

# ---- group: Top
pline = PolyLine(Vertices=move.Geometry, Closed=False)

# ---- group: Middle
pline_2 = PolyLine(Vertices=weave, Closed=False)

# ---- group: Bottom
pline_3 = PolyLine(Vertices=cull_2, Closed=False)

# ---- group: Join spheres
sph = Sphere(Base=weave, Radius=panel_6)

# ---- group: Beams
crv = Curve([pline, pline_2, pline_3])

# ---- group: Joints
srf = Surface(sph)
