# Grasshopper definition Tutorial-2-5-4-Pearl-necklace.gh (Grasshopper 1.0.8)

# ---- group: Number of pearls
number_slider = Slider(15, range=15..25)

# ---- group: Input curve
# Solution
crv = Curve(reparameterize(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))

# ----
# Q2
# Create a necklace with one big pearl in the middle, and gradually smaller size pearls towards the ends as in the image. Make number of pearls parametric odd number between 15-25
image = ImageSampler(Filter="Colour", Interpolate=False, Umax=1, Umin=0, Vmax=1, Vmin=0, Wrap=1)

# ---- group: Create ordered list of normalized distances
range = Range(Domain=Domain(0, 1), Steps=number_slider)
graph = GraphMapper(range, x0=0, x1=1, y0=0, y1=1, container_name="Bezier", cpx=[0, 0.4057970941, 0.6021741629, 1], cpy=[0, 0, 1, 1])

# ---- group: Distances
panel = Panel(graph)

# ---- group: Divide curve with variable distances
eval = EvaluateLength(Curve=crv, Length=graph, Normalized=True)  # -> Point, Tangent, Parameter

# ---- group: Extract segments as lines
pline = PolyLine(Vertices=eval.Point, Closed=False)
explode = Explode(Curve=pline, Recursive=True)  # -> Segments, Vertices

# ---- group: Find mid point of each line
eval_2 = EvaluateLength(Curve=reparameterize(explode.Segments), Length="0.5", Normalized=True)  # -> Point, Tangent, Parameter

# ---- group: Find radius (len/2)
len = Length(Curve=explode.Segments)
division = Division(A=len, B="2")

# ---- group: Generate pearls
sph = Sphere(Base=eval_2.Point, Radius=division)

# ---- group: Pearls
srf = Surface(sph)
