# Grasshopper definition ExportTo3MFV3.gh (Grasshopper 1.0.8)
# plug-ins: RhinoCodePluginGH

title = Panel("My 3MF from Grasshopper")
geometry_pipeline = GeometryPipeline(
    GroupByLayer=False,
    GroupByType=False,
    IncludeHidden=True,
    IncludeLocked=True,
    LayerFilter="*",
    NameFilter="*",
    SublayerFiltering=True,
    TypeFilter=1073741880)
python_3_script = Python3Script(objects=geometry_pipeline, title=title, path="%USERPROFILE%\Desktop\Test.3mf")  # -> out; inputs objects: list of GeometryBase
# ---------- python_3_script: Python ----------
import System
import Rhino

doc = Rhino.RhinoDoc.CreateHeadless(None)

if not objects is None:
    for o in objects:
        doc.Objects.Add(o)

options = Rhino.FileIO.File3mfWriteOptions()
options.Title = title
options.Designer = Rhino.RhinoApp.LicenseUserName
options.Metadata["Test"] = "Star"
options.MoveOutputToPositiveXYZOctant = True;

if not path is None:
    path = System.Environment.ExpandEnvironmentVariables(path)
    sucess = doc.Export(path, options.ToDictionary())
    print(sucess)
doc.Dispose();
# ---------- end python_3_script ----------
panel = Panel(python_3_script)
