# Grasshopper definition csharp-component-outputpreview.ghx (Grasshopper 1.0.8)
# plug-ins: RhinoCodePluginGH

c_script = CSharpScript()  # -> sphere, box
# ---------- c_script: C# ----------
using System;
using Rhino;
using Rhino.Geometry;

sphere = new Sphere(Point3d.Origin, 10);
box = new Box(new BoundingBox(10, 10, 0, 20, 20, 20));
# ---------- end c_script ----------
panel = Panel(c_script.sphere)
panel_2 = Panel(c_script.box)
