# Grasshopper definition python3-component-paramaccess.ghx (Grasshopper 1.0.8)
# plug-ins: RhinoCodePluginGH

number = Number(Tree({0}: [0], {1}: [0]))
# Item
python_3_script = Python3Script(x=number)  # -> out
# ---------- python_3_script: Python ----------
print(type(x))
# ---------- end python_3_script ----------
# List
python_3_script_2 = Python3Script(x=number)  # -> out; inputs x: list; same code as python_3_script
# Tree
python_3_script_3 = Python3Script(x=number)  # -> out; inputs x: tree of Double; same code as python_3_script
panel = Panel(python_3_script)
panel_2 = Panel(python_3_script_2)
panel_3 = Panel(python_3_script_3)
