# Grasshopper definition python3-component-scriptmode-simple.ghx (Grasshopper 1.0.8)
# plug-ins: RhinoCodePluginGH

panel = Panel("""Apple
Pear
Peach
Apricot""")
python_3_script = Python3Script()  # -> out, a
# ---------- python_3_script: Python ----------
"""Grasshopper Script"""
import System
import Rhino
import Grasshopper

import rhinoscriptsyntax as rs

class MyComponent(Grasshopper.Kernel.GH_ScriptInstance):
    def RunScript(self, x, y):
        return
# ---------- end python_3_script ----------
python_3_script_2 = Python3Script(x=panel)  # -> a
# ---------- python_3_script_2: Python ----------
a = f'Hello {x}'
# ---------- end python_3_script_2 ----------
panel_2 = Panel(python_3_script_2)
