# Grasshopper definition python3-component-sharedscript.ghx (Grasshopper 1.0.8)
# plug-ins: RhinoCodePluginGH

panel = Panel("""#! python 3

a = x + y

print(a)""")
number_slider = Slider(21, range=0..100)
number_slider_2 = Slider(21, range=0..100)
script = Script(Script=panel, X=number_slider, Y=number_slider_2)  # -> Out, A
c_script = CSharpScript(script=panel, x=number_slider, y=number_slider_2)  # -> out, a; inputs x: Double, y: Double
#   port script: Script to execute
# ---------- c_script: C# ----------
// Grasshopper Script Instance
#region Usings
using System;
using System.Linq;
using System.Collections;
using System.Collections.Generic;
using System.Drawing;

using Rhino;
using Rhino.Geometry;

using Grasshopper;
using Grasshopper.Kernel;
using Grasshopper.Kernel.Data;
using Grasshopper.Kernel.Types;
#endregion

public class Script_Instance : GH_ScriptInstance
{
    #region Notes
    /* 
      Members:
        RhinoDoc RhinoDocument
        GH_Document GrasshopperDocument
        IGH_Component Component
        int Iteration

      Methods (Virtual & overridable):
        Print(string text)
        Print(string format, params object[] args)
        Reflect(object obj)
        Reflect(object obj, string method_name)
    */
    #endregion

    private void RunScript(object x, object y, ref object a)
    {
        // Write your logic here
        a = null;
    }
}
# ---------- end c_script ----------
panel_2 = Panel(c_script.a)
panel_3 = Panel(script.A)
