# Grasshopper definition component_ctx.ghx (Grasshopper 1.0.7)
# plug-ins: RhinoCodePluginGH

integer = Integer(12)
integer_2 = Integer(18)
get_integer = GetInteger(integer_2, AtLeast=1, AtMost=1, Maximum=2147483647, Minimum=-2147483648, Prompt="Second Number", TreeAccess=False)
get_integer_2 = GetInteger(integer, AtLeast=1, AtMost=1, Maximum=2147483647, Minimum=-2147483648, Prompt="First Number", TreeAccess=False)
adder = Script(x=get_integer_2, y=get_integer)  # -> out, a; inputs y: Int32
# ---------- adder: Python ----------
a = x + y + 50
# ---------- end adder ----------
context_print = ContextPrint(Text=adder.a)
