# Grasshopper definition ctx_geom.gh (Grasshopper 1.0.8)

sphere = Sphere(Base=PlaneXY(0, 0, 0), Radius=1)
brep = GetGeometry(sphere, AnnotationTypeFilter=0, AtLeast=1, AtMost=1, DeleteInput=False, Filter=16, TreeAccess=False)
geometry = GetGeometry(sphere, AnnotationTypeFilter=3966, AtLeast=1, AtMost=1, DeleteInput=False, Filter=1074081855, TreeAccess=False)
volume = Volume(Geometry=[brep, geometry])  # -> Volume, Centroid
volume_2 = ContextPrint(Volume=volume.Volume)
context_bake = ContextBake(Content=[brep, geometry])
