# Grasshopper definition csharp-component-sharedscript_2.ghx (Grasshopper 1.0.8)
# plug-ins: RhinoCodePluginGH

number_slider = Slider(21, range=0..100)
number_slider_2 = Slider(21, range=0..100)
python_3_script = Python3Script(x=number_slider, y=number_slider_2)  # -> script, a
#   port script: Script being executed
# ---------- python_3_script: Python ----------
a = x + y + 10
# ---------- end python_3_script ----------
c_script = CSharpScript(x=number_slider, y=number_slider_2)  # -> script, a; inputs x: Double, y: Double
#   port script: Script being executed
# ---------- c_script: C# ----------
using System;

a = x + y;

Console.WriteLine(a);
# ---------- end c_script ----------
c_script_2 = CSharpScript(script=[c_script.script, python_3_script.script], x=number_slider, y=number_slider_2)  # -> out, a; inputs x: Double, y: Double
#   port script: Script to execute
# ---------- c_script_2: C# ----------
// Grasshopper Script Instance
#region Usings
using System;
using System.Linq;
using System.Collections;
using System.Collections.Generic;
using System.Drawing;

using Rhino;
using Rhino.Geometry;

using Grasshopper;
using Grasshopper.Kernel;
using Grasshopper.Kernel.Data;
using Grasshopper.Kernel.Types;
#endregion

public class Script_Instance : GH_ScriptInstance
{
    #region Notes
    /* 
      Members:
        RhinoDoc RhinoDocument
        GH_Document GrasshopperDocument
        IGH_Component Component
        int Iteration

      Methods (Virtual & overridable):
        Print(string text)
        Print(string format, params object[] args)
        Reflect(object obj)
        Reflect(object obj, string method_name)
    */
    #endregion

    private void RunScript(object x, object y, ref object a)
    {
        // Write your logic here
        a = null;
    }
}
# ---------- end c_script_2 ----------
panel = Panel(c_script_2.a)
panel_2 = Panel(c_script.a)
